# Grasshopper definition ML.gh (Grasshopper 1.0.7)
# Copyright: Arup
# plug-ins: HFTidyCanvas

number_slider = Slider(36, range=0..100)
series = Series(Start=0, Step=1, Count=Slider(1000, range=0..1000))  # -> graft(Series)
python = GhPythonScript(x=series)  # -> out, width, height, rotate
# ---------- python: Python ----------
__author__ = "ismael.sanz"
__version__ = "2020.04.09"

import rhinoscriptsyntax as rs

from random import randint, choice

max = 100

width = []
height = []
rotate = []


for i in range(4):
    width.append(randint(10, max))
    height.append(randint(10, max))
    rotate.append(choice([0,1]))
# ---------- end python ----------
width = DataDescription(python.width)
heigth = DataDescription(python.height)
rotate = DataDescription(python.rotate)
rotate_2 = Rotate(rotate)
rotate_3 = Rotate(rotate_2)
tstat = TreeStatistics(Tree=rotate_3)  # -> Paths, Length, Count
item = ListItem(List=tstat.Paths, Index=0, Wrap=True)
branch = TreeBranch(Tree=rotate_3, Path=item, MaintainPaths=True)
width_2 = Width(width)
heigth_2 = Heigth(heigth)
branch_2 = DataDescription(branch)
index = ItemIndex(List=branch_2, Item=branch_2)
concat = Concatenate(FragmentA="h", FragmentB=index)
concat_2 = Concatenate(FragmentA="w", FragmentB=index)
width_3 = Width(width_2)
heigth_3 = Heigth(heigth_2)
rotate_4 = Rotate(rotate_2)
concat_3 = Concatenate(FragmentA="rot_", FragmentB=index)
merge = Merge(Data1=width_3, Data2=heigth_3, Data3=rotate_4)
weave = Weave(Pattern=[0, 1, 2], Stream0=width_3, Stream1=heigth_3, Stream2=rotate_4, NullGaps=False)
weave_2 = Weave(Pattern=[0, 1, 2], Stream0=concat_2, Stream1=concat, Stream2=concat_3, NullGaps=False)
headers = DataDescription(weave_2)
entwine = Entwine(Branch0X=headers, Branch1X=weave, FlattenInputs=False)
input = DataDescription(entwine)
python_2 = GhPythonScript(width=width, heigth=heigth, rotate=rotate)  # -> a, width, heigth
# ---------- python_2: Python ----------
if rotate:
    width2 = heigth
    heigth2 = width
    width = width2
    heigth = heigth2
else:
    width = width
    heigth = heigth
# ---------- end python_2 ----------
join = TextJoin(Text=input, Join=",")  # -> flatten(Result)
width_4 = DataDescription(python_2.width)
heigth_4 = DataDescription(python_2.heigth)
addition = Addition(A="20", B=width_4)
ma = MassAddition(Input=addition)  # -> Result, PartialResults
x = DataDescription(ma.PartialResults)
ins = InsertItems(List=x, Item="0", Indices="0", Wrap=True)
cull_i = CullIndex(List=ins, Indices="-1", Wrap=True)
x_2 = DataDescription(cull_i)
width_5 = Width(width_4)
heigth_5 = Heigth(heigth_4)
xy = XYPlane(Origin=Point(0, 0, 0))
x_3 = X(x_2)
width_6 = Width(width_5)
heigth_6 = Heigth(heigth_5)
width_7 = Width(width_5)
x_4 = X(x_2)
heigth_7 = Heigth(heigth_5)
pt = ConstructPoint(XCoordinate=x_3, YCoordinate=0, ZCoordinate=0)
heigth_8 = Heigth(heigth_7)
x_5 = DataDescription(pt)
rectangle = Rectangle(Plane=x_5, XSize=width_6, YSize=heigth_6, Radius=0)  # -> Rectangle, Length
heigth_9 = Rotate(heigth_8)
tstat_2 = TreeStatistics(Tree=heigth_9)  # -> Paths, Length, Count
item_2 = ListItem(List=tstat_2.Paths, Index=0, Wrap=True)
branch_3 = TreeBranch(Tree=heigth_9, Path=item_2, MaintainPaths=True)
branch_4 = DataDescription(branch_3)
index_2 = ItemIndex(List=branch_4, Item=branch_4)
x_6 = X(simplify(x_4))
width_8 = Width(simplify(width_7))
heigth_10 = Heigth(simplify(heigth_8))
concat_4 = Concatenate(FragmentA="x", FragmentB=index_2)
concat_5 = Concatenate(FragmentA="w", FragmentB=index_2)
concat_6 = Concatenate(FragmentA="h", FragmentB=index_2)
weave_3 = Weave(Pattern=[0, 1, 2], Stream0=x_6, Stream1=width_8, Stream2=heigth_10, NullGaps=False)
weave_4 = Weave(Pattern=[0, 1, 2], Stream0=concat_4, Stream1=concat_5, Stream2=concat_6, NullGaps=False)
headers_2 = DataDescription(weave_4)
entwine_2 = Entwine(Branch0X=headers_2, Branch1X=weave_3, FlattenInputs=False)
input_2 = DataDescription(entwine_2)
input_3 = DataDescription(join)
number_slider_2 = Slider(10, range=0..10)
join_2 = TextJoin(Text=input_2, Join=",")  # -> flatten(Result)
button = Button()
path = DataDescription("C:\Users\ismael.sanz\Desktop\ML\input\")
cluster = Cluster_2(output=input_3, B=number_slider_2)  # -> A, R
cluster_2 = Cluster(output=join_2, B=number_slider_2)  # -> A, R
output = Output(cluster_2.R)
path_2 = Path(path)
output_2 = Output(cluster_2.A)
path_3 = Path(path)
output_3 = Output(cluster.R)
path_4 = Path(path)
output_4 = Output(cluster.A)
path_5 = Path(path)
python_3 = GhPythonScript(x=output, path=path_2, file_name="output_to_predict.csv", run=button)  # -> out, a; inputs x: list
# ---------- python_3: Python ----------
import csv
#path = r"C:\Users\ismael.sanz\Desktop\ML\input\output.csv"

path = path + file_name

if run:
    with open (path, "wb") as csv_file:
        writer = csv.writer(csv_file)
        for row in x:
            list_row = row.split(",")
            writer.writerow(list_row)
# ---------- end python_3 ----------
python_4 = GhPythonScript(x=output_2, path=path_3, file_name="output.csv", run=button)  # -> out, a; inputs x: list; same code as python_3
python_5 = GhPythonScript(x=output_3, path=path_4, file_name="input_to_predict.csv", run=button)  # -> out, a; inputs x: list; same code as python_3
python_6 = GhPythonScript(x=output_4, path=path_5, file_name="input.csv", run=button)  # -> out, a; inputs x: list; same code as python_3

# ==== cluster Cluster
output = ClusterInput()
B = ClusterInput()
output_2 = Output(output)
lng = ListLength(List=output_2)
subtraction = Subtraction(A=lng, B=B)
split = SplitList(List=output_2, Index=subtraction)  # -> ListA, ListB
A = ClusterOutput(split.ListA)
item = ListItem(List=output_2, Index=0, Wrap=True)
merge = Merge(Data1=item, Data2=split.ListB)  # -> flatten(Result)
R = ClusterOutput(merge)

# ==== cluster Cluster_2
output = ClusterInput()
output_2 = Output(output)
B = ClusterInput()
lng = ListLength(List=output_2)
subtraction = Subtraction(A=lng, B=B)
split = SplitList(List=output_2, Index=subtraction)  # -> ListA, ListB
item = ListItem(List=output_2, Index=0, Wrap=True)
A = ClusterOutput(split.ListA)
merge = Merge(Data1=item, Data2=split.ListB)  # -> flatten(Result)
R = ClusterOutput(merge)
